# Dynamo graph Rebar Numbering Setup.dyn (Dynamo 2.1.0.7500)

# group: Set Schedule Mark to Rebar Number
code_block = CodeBlock { "Structural Rebar"; }
byName = Category.ByName(name=code_block)
all_elements_of_category = ElementsOfCategory(Category=byName)
code_block_2 = CodeBlock { "Schedule Mark"; }
code_block_3 = CodeBlock { "Rebar Number"; }
parameterByName = Parameter.ParameterByName(element=all_elements_of_category, name=code_block_3)
value = Parameter.Value(parameter=parameterByName)
setParameterByName = Element.SetParameterByName(element=all_elements_of_category, parameterName=code_block_2, value=value)

# group: Create Schedule
code_block_4 = CodeBlock { "Rebar Number Control"; }
schedule_type = ScheduleTypes("RegularSchedule")  # graph input
createSchedule = ScheduleView.CreateSchedule(category=byName, name=code_block_4, scheduleType=schedule_type)
schedulableFields = ScheduleView.SchedulableFields(scheduleView=createSchedule)
code_block_5 = CodeBlock()
# ---------- code_block_5.designscript (16 lines) ----------
["Partition",
"Schedule Mark",
"Rebar Number",
"Family and Type",
"Shape",
"Bar Length",
"A",
"B",
"C",
"D",
"E",
"F",
"G",
"H",
"J",
"R"];
# ----------------------------------------
count = List.Count(list=code_block_5)
ofRepeatedItem = List.OfRepeatedItem(item=schedulableFields, amount=count)
code_block_6 = CodeBlock { "OUT = [[str(y) == x for y in IN[0]] for x in IN[1]]"; }
python_script_from_string = PythonStringNode(script=code_block_6, IN[0]=schedulableFields, IN[1]=code_block_5)
filterByBoolMask = List.FilterByBoolMask(list=ofRepeatedItem, mask=python_script_from_string)
flatten = List.Flatten(list=filterByBoolMask.in)
addFields = ScheduleView.AddFields(scheduleView=createSchedule, fields=flatten)
