# Dynamo graph Rebar Numbering.dyn (Dynamo 2.1.0.7500)

# group: Get Rebar
categories = Categories("OST_Rebar")  # graph input
all_elements_of_category = ElementsOfCategory(Category=categories)

# group: Split Rebar into Partitions
code_block = CodeBlock { "OUT = [[x == y for y in IN[1]] for x in IN[0]]"; }
code_block_2 = CodeBlock { "Partition"; }
getParameterValueByName = Element.GetParameterValueByName(element=all_elements_of_category, parameterName=code_block_2)
uniqueItems = List.UniqueItems(list=getParameterValueByName)
python_script_from_string = PythonStringNode(script=code_block, IN[0]=uniqueItems, IN[1]=getParameterValueByName)
count = List.Count(list=python_script_from_string)
ofRepeatedItem = List.OfRepeatedItem(item=all_elements_of_category, amount=count)
code_block_3 = CodeBlock { null; }
if_ = If(test=python_script_from_string, true=ofRepeatedItem, false=code_block_3)
code_block_4 = CodeBlock { false; }
clean = List.Clean(list=if_, preserveIndices=code_block_4)

# group: Set Rebar Mark to Schedule Mark
code_block_5 = CodeBlock { "Schedule Mark"; }
getParameterValueByName_2 = Element.GetParameterValueByName(element=clean, parameterName=code_block_5)
sortByKey = List.SortByKey(list=clean, keys=getParameterValueByName_2, lacing=Longest)
python_script = Python(IN[0]=sortByKey.sorted_list, IN[1]=uniqueItems)
# ---------- python_script.python (54 lines) ----------
import clr 
 
clr.AddReference('RevitAPI') 
from Autodesk.Revit.DB import * 
from Autodesk.Revit.DB.Structure import * 
 
clr.AddReference('System') 
from System.Collections.Generic import List 
 
clr.AddReference('RevitNodes') 
import Revit 
clr.ImportExtensions(Revit.GeometryConversion) 
clr.ImportExtensions(Revit.Elements) 
 
clr.AddReference('RevitServices') 
import RevitServices 
from RevitServices.Persistence import DocumentManager 
from RevitServices.Transactions import TransactionManager 
 
clr.AddReference('RevitAPIUI')
from Autodesk.Revit.UI import TaskDialog
 
doc = DocumentManager.Instance.CurrentDBDocument 
 
#Preparing input from dynamo to revit 
sortedRebarsList = UnwrapElement(IN[0])
nameList = IN[1]

for i in range(len(nameList)):
	sortedRebars = sortedRebarsList[i]
	name = nameList[i]

	#Do some action in a Transaction 
	TransactionManager.Instance.EnsureInTransaction(doc) 
	schema = NumberingSchema.GetNumberingSchema(doc,NumberingSchemaTypes.StructuralNumberingSchemas.Rebar)
	schema.RemoveGaps(name)

	range = schema.GetNumbers(name)
	range = range[0]
	rangeSpan = 1 + (range.High - range.Low)
	startNumber = rangeSpan+1000
	schema.ShiftNumbers(name, startNumber)
	
	for e in sortedRebars:
		num = int(e.get_Parameter(BuiltInParameter.REBAR_NUMBER).AsString())
		schedule_mark = int(e.get_Parameter(BuiltInParameter.REBAR_ELEM_SCHEDULE_MARK).AsString())
		if num != schedule_mark:
			try:
				schema.ChangeNumber(name, num, schedule_mark)
			except:
				TaskDialog.Show('Script Error', 'Duplicate schedule marks found. Please check all schedule marks are unique within each partition')
				break
	#schema.RemoveGaps(name)
	TransactionManager.Instance.TransactionTaskDone() 
# ----------------------------------------
